# Grasshopper definition DescaleBreps.gh (Grasshopper 1.0.8)

# ----
# INPUT
geometry_pipeline = GeometryPipeline(
    GroupByLayer=False,
    GroupByType=False,
    IncludeHidden=True,
    IncludeLocked=True,
    LayerFilter="A-WALL",
    NameFilter="*",
    SublayerFiltering=True,
    TypeFilter=1073741848)
geometry_pipeline_2 = GeometryPipeline(
    GroupByLayer=False,
    GroupByType=False,
    IncludeHidden=True,
    IncludeLocked=True,
    LayerFilter="A-FLOR",
    NameFilter="*",
    SublayerFiltering=True,
    TypeFilter=1073741848)

brepfloorlarge = Brep(geometry_pipeline_2)
brepwalllarge = Brep(geometry_pipeline)
scale = Scale(Geometry=brepwalllarge, Center=Point(0, 0, 0), Factor=Slider(0.001, range=0..0.001))  # -> Geometry, Transform
scale_2 = Scale(Geometry=brepfloorlarge, Center=Point(0, 0, 0), Factor=Slider(0.001, range=0..0.001))  # -> Geometry, Transform
unit_z = UnitZ(Factor="0.048")
unit_z_2 = UnitZ(Factor="0.048")
brep = Brep(scale_2.Geometry)
brep_2 = Brep(scale.Geometry)
move = Move(Geometry=brep_2, Motion=unit_z_2)  # -> Geometry, Transform
move_2 = Move(Geometry=brep, Motion=unit_z)  # -> Geometry, Transform

# ----
# Descaling the Brep
brepfloorsforinput = Brep(move_2.Geometry)
brepwallsforinput = Brep(move.Geometry)
panel = Panel("0.6")
