# Grasshopper definition StudyCase1.gh (Grasshopper 1.0.8)
# plug-ins: MasterThesisCode1

brepfloorlarge = Brep([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])
brepwalllarge = Brep([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])
brep = Brep(brepfloorlarge)
brep_2 = Brep(brepwalllarge)
scale = Scale(Geometry=brep, Center=Point(0, 0, 0), Factor=Slider(0.001, range=0..0.001))  # -> Geometry, Transform
scale_2 = Scale(Geometry=brep_2, Center=Point(0, 0, 0), Factor=Slider(0.001, range=0..0.001))  # -> Geometry, Transform
unit_z = UnitZ(Factor="0.048")
unit_z_2 = UnitZ(Factor="0.048")
brep_3 = Brep(scale.Geometry)
brep_4 = Brep(scale_2.Geometry)
move = Move(Geometry=brep_3, Motion=unit_z)  # -> Geometry, Transform
move_2 = Move(Geometry=brep_4, Motion=unit_z_2)  # -> Geometry, Transform

brepwalls = Brep(move_2.Geometry)
brepfloors = Brep(move.Geometry)

studwork_with_openings_for_brep_walls = StudworkWithOpeningsForBrepWalls(Walls=brepwalls, Floors=brepfloors, CenterDistance="0.6")

# ----
# Incase the plug-in does not work or other issues!
# This component has saved the datatree inside it
# Just enable preview
resultsfromplug_in = Brep(Tree({0;0;0}: [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], {0;0;1}: [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], {0;1;0}: [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], {0;1;1}: [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], {0;2;0}: [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], {0;2;1}: [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], {0;3;0}: [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], {0;3;1}: [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], {1;0;0}: [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]))

param_viewer = ParamViewer(studwork_with_openings_for_brep_walls)
