# Grasshopper definition StudyCase3.gh (Grasshopper 1.0.8)
# plug-ins: Pufferfish, MasterThesisCode1

brepwalllarge = Brep([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])
brepfloorlarge = Brep([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])
construct_point = ConstructPoint(XCoordinate=0, YCoordinate=0, ZCoordinate="0.048")
brep = Brep(brepwalllarge)
brep_2 = Brep(brepfloorlarge)
scale = Scale(Geometry=brep, Center=Point(0, 0, 0), Factor=Slider(0.001, range=0..0.001))  # -> Geometry, Transform
scale_2 = Scale(Geometry=brep_2, Center=Point(0, 0, 0), Factor=Slider(0.001, range=0..0.001))  # -> Geometry, Transform
deconstruct_brep = DeconstructBrep(Brep=scale_2.Geometry)  # -> Faces, Edges, Vertices
list_item = ListItem(List=flatten(deconstruct_brep.Vertices), Index=0, Wrap=True)  # -> Item, Item1
brep_3 = Brep(scale.Geometry)
brep_4 = Brep(scale_2.Geometry)
move_to_point = MoveToPoint(Geometry=brep_3, PointA=list_item.Item1, PointB=construct_point)  # -> Moved, Vector, Transform
move_to_point_2 = MoveToPoint(Geometry=brep_4, PointA=list_item.Item1, PointB=construct_point)  # -> Moved, Vector, Transform
brepfloors = Brep(move_to_point_2.Moved)
brepwalls = Brep(move_to_point.Moved)

# ----
# Incase the plug-in does not work or other issues!
# This component has saved the datatree inside it
# Just enable preview
resultsfromtheplug_in = Brep(Tree({0;0;0}: [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], {0;0;1}: [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], {0;1;0}: [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], {0;1;1}: [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], {0;2;0}: [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], {0;2;1}: [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], {0;3;0}: [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], {0;3;1}: [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], {1;0;0}: [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]))

studwork_with_openings_for_brep_walls = StudworkWithOpeningsForBrepWalls(Walls=brepwalls, Floors=brepfloors, CenterDistance="0.6")
